# Grasshopper definition grid-random-walk.gh (Grasshopper 1.0.7)
# plug-ins: OpenNest

number_slider = Slider(8, range=0..10)
number_slider_2 = Slider(7, range=0..10)
sqgrid = Square(Plane=PlaneXY(0, 0, 0), Size=1, ExtentX=number_slider, ExtentY=number_slider_2)  # -> flatten(Cells), Points
python = GhPythonScript(Ex=number_slider, Ey=number_slider_2, L=Slider(20, range=1..25), S=Slider(69, range=0..100))  # -> out, I; inputs Ex: Int32, Ey: Int32, L: Int32, S: Int32
# ---------- python: Python ----------
import math
import random


class Grid:
    def __init__(self, rows, columns):
        self.__rows = rows
        self.__columns = columns
    
    @property
    def rows(self):
        return self.__rows
    
    @property
    def columns(self):
        return self.__columns
    
    @property
    def size(self):
        return self.__rows * self.__columns
        
        
    def get_index(self, x, y):
        return x + y * self.__columns
    
    def get_row(self, i):
        return int(i / self.__columns)
    
    def get_column(self, i):
        return int(math.floor(i % self.__columns))
    
    def get_adjacent(self, i):
        x = self.get_column(i)
        y = self.get_row(i)
        
        adjacent = [] 
        if y - 1 >= 0:  # northern neighbour
            adjacent.append(self.get_index(x, y-1))
        if x + 1 < self.__columns:  # eastern neighbour
            adjacent.append(self.get_index(x+1, y))
        if y + 1 < self.__rows:  # southern neighbour
            adjacent.append(self.get_index(x, y+1))
        if x - 1 >= 0:  # western neighbour
            adjacent.append(self.get_index(x-1, y))
        
        return adjacent
        

if __name__ == "__main__":
    if S is not None:
        random.seed(S)
    
    g = Grid(Ex, Ey)
    
    visited = {i: False for i in range(g.size)}
    
    path = []
    ci = random.choice(list((range(g.size))))  # current index
    path.append(ci)
    visited[ci] = True

    while len(path) < L and not all(visited.values()):
        candidates = [i for i in g.get_adjacent(ci) if not visited[i]]

        if len(candidates) < 1:
            print "Cell {} is a dead end".format(ci)
            break
        
        ni = random.choice(candidates)  # next index
        path.append(ni)
        visited[ni] = True
        ci = ni
    
    
    # Outputs
    I = path
# ---------- end python ----------
preview = CustomPreview(Geometry=sqgrid.Cells, Material=ColourSwatch(SwatchColor=RGB(172, 0, 254)))
item = ListItem(List=sqgrid.Cells, Index=python.I, Wrap=True)
pcen = PolygonCenter(Polyline=sqgrid.Cells)  # -> CenterV, CenterE, CenterA
smesh = SimpleMesh(Brep=item)
index = ItemIndex(List=sqgrid.Cells, Item=sqgrid.Cells)
lng = ListLength(List=smesh)
text = Text(Location=pcen.CenterV, Text=index, Size=Slider(0.19, range=0.01..1))
range = Range(Domain=Domain(0, 1), Steps=lng)
gradient = Gradient(LowerLimit=0, UpperLimit=1, Parameter=range, stops=[0: RGB(255, 130, 160), 1: RGB(220, 0, 40)])
preview_2 = CustomPreview(Geometry=smesh, Material=gradient)
