# Grasshopper definition grid-random-walks.gh (Grasshopper 1.0.7)
# plug-ins: OpenNest

number_slider = Slider(8, range=0..10)
number_slider_2 = Slider(7, range=0..10)
sqgrid = Square(Plane=PlaneXY(0, 0, 0), Size=1, ExtentX=number_slider, ExtentY=number_slider_2)  # -> flatten(Cells), Points
python = GhPythonScript(Ex=number_slider, Ey=number_slider_2, L=Slider(6, range=1..25))  # -> out, I; inputs Ex: Int32, Ey: Int32, L: Int32, S: Int32
# ---------- python: Python ----------
import math
import random

from ghpythonlib import treehelpers


class Grid:
    def __init__(self, rows, columns):
        self.__rows = rows
        self.__columns = columns
    
    @property
    def rows(self):
        return self.__rows
    
    @property
    def columns(self):
        return self.__columns
    
    @property
    def size(self):
        return self.__rows * self.__columns
        
        
    def get_index(self, x, y):
        return x + y * self.__columns
    
    def get_row(self, i):
        return int(i / self.__columns)
    
    def get_column(self, i):
        return int(math.floor(i % self.__columns))
    
    def get_adjacent(self, i):
        x = self.get_column(i)
        y = self.get_row(i)
        
        adjacent = [] 
        if y - 1 >= 0:  # northern neighbour
            adjacent.append(self.get_index(x, y-1))
        if x + 1 < self.__columns:  # eastern neighbour
            adjacent.append(self.get_index(x+1, y))
        if y + 1 < self.__rows:  # southern neighbour
            adjacent.append(self.get_index(x, y+1))
        if x - 1 >= 0:  # western neighbour
            adjacent.append(self.get_index(x-1, y))
        
        return adjacent
        

if __name__ == "__main__":
    if S is not None:
        random.seed(S)
    
    g = Grid(Ex, Ey)
    
    visited = {i: False for i in range(g.size)}
    
    paths = []
    pi = 0  # current path index
    ppi = -1  # previous path index
    
    while not all(visited.values()):
        if pi > ppi:  # start new path
            paths.append([])
            
            available = [k for k, v in visited.iteritems() if not v]
            if len(available) < 1:
                break
            
            ci = random.choice(available)  # current index
            paths[pi].append(ci)
            visited[ci] = True
            
            ppi = pi
            
        else:  # continue with current path
            if len(paths[pi]) == L:
                pi += 1
                continue
            
            ci = paths[pi][-1]
            
            candidates = [i for i in g.get_adjacent(ci) if not visited[i]]
            if len(candidates) < 1:
                print "Cell {} is a dead end".format(ci)
                pi += 1
                continue
            
            ni = random.choice(candidates)  # next index
            paths[pi].append(ni)
            visited[ni] = True
        

    # Outputs
    I = treehelpers.list_to_tree(paths)
# ---------- end python ----------
preview = CustomPreview(Geometry=sqgrid.Cells, Material=ColourSwatch(SwatchColor=RGB(172, 0, 254)))
panel = Panel(python.out)
item = ListItem(List=sqgrid.Cells, Index=python.I, Wrap=True)
pcen = PolygonCenter(Polyline=sqgrid.Cells)  # -> CenterV, CenterE, CenterA
smesh = SimpleMesh(Brep=item)
index = ItemIndex(List=sqgrid.Cells, Item=sqgrid.Cells)
text = Text(Location=pcen.CenterV, Text=index, Size=Slider(0.19, range=0.01..1))
lng = ListLength(List=flatten(smesh))
wheel = ColourWheel(
    lng,
    ColourGrips_Style=10,
    ColourGrips_Grip=[5.204172115, 2.094395102, 4.188790205, 3.141592654],
    ColourGrips_Lum=[0.4313773725, 0.7013576232],
    ColourGrips_Range=[1.329306574, 1.329306574, 1.329306574, 1.329306574],
    ColourGrips_Sat=[0.3154881839, 1])
preview_2 = CustomPreview(Geometry=smesh, Material=graft(wheel))
